# Grasshopper definition testMini.gh (Grasshopper 0.9.76)
# plug-ins: minimalSurface, tennisBall

crv = Curve([<curve referenced from the Rhino model> x3])
tennis = TennisBall(Sd=1)  # disabled
panel = Panel(crv)
crv_2 = Curve(tennis)
mini = MinimalSurface(InputCurve=crv, AppNrVertices=Slider(4028.253, range=0..5000), WeierstrassAngle=Slider(0.613, range=0..7))
panel_2 = Panel(mini)
material = CreateMaterial(
    Diffuse=ColourSwatch(SwatchColor=RGB(5, 4, 4)),
    Specular=ColourSwatch(SwatchColor=RGB(40, 130, 114)),
    Emission=ColourSwatch(SwatchColor=RGB(71, 71, 71)),
    Transparency=Slider(0.13, range=0..1),
    Shine=Slider(0, range=0..1000))
mesh = Mesh(mini)
preview = CustomPreview(Geometry=mini, Shader=material)
